# Grasshopper definition boolean_gate.gh (Grasshopper 1.0.7)
# plug-ins: Data Tools

# ---- group: Move slider to update values
number_slider = Slider(0, range=0..10)

# ----
bool = Boolean(number_slider)
boolean_gate = BooleanGate(Bool=number_slider)
rec = DataRecorder(bool, DataLimit=-10, RecordData=True)
rec_2 = DataRecorder(boolean_gate, DataLimit=-10, RecordData=True)
panel = Panel(rec)
panel_2 = Panel(rec_2)
