# Grasshopper definition test_gates.gh (Grasshopper 1.0.7)
# plug-ins: Dynamic Data Tools

panel = Panel("""True
False
True
False""")
panel_2 = Panel("""True
False
True
False""")
panel_3 = Panel("""True
False
True
False""")
panel_4 = Panel("""True
False
False
False""")
flatten = FlattenTree(Tree=panel, Path="{3}")
flatten_2 = FlattenTree(Tree=panel_2, Path="{2;1}")
flatten_3 = FlattenTree(Tree=panel_3, Path="{1}")
flatten_4 = FlattenTree(Tree=panel_4, Path="{0;45}")
merge = Merge(Data1=flatten_3, Data2=flatten_2, Data3=flatten, Data4=flatten_4)
panel_5 = Panel(merge)
boolean_gate = BooleanGate(Bool=merge)
boolean_gate_2 = BooleanGate(Bool=Slider(0, range=0..10))
rec = DataRecorder(boolean_gate, DataLimit=-10, RecordData=True)
panel_6 = Panel(boolean_gate)
rec_2 = DataRecorder(boolean_gate_2, DataLimit=-10, RecordData=True)
panel_7 = Panel(rec_2)
panel_8 = Panel(rec)
panel_9 = Panel("""1
2
3
4""")
panel_10 = Panel("""1
2
3
4""")
panel_11 = Panel("""1
2
3
4""")
panel_12 = Panel("""1
2
3
4""")
flatten_5 = FlattenTree(Tree=panel_9, Path="{3}")
flatten_6 = FlattenTree(Tree=panel_11, Path="{2;1}")
flatten_7 = FlattenTree(Tree=panel_10, Path="{1}")
flatten_8 = FlattenTree(Tree=panel_12, Path="{0;45}")
number_slider = Slider(7, range=0..10)
timer = Timer(TimerInterval=100, Target=number_slider)  # disabled
merge_2 = Merge(Data1=flatten_7, Data2=flatten_6, Data3=flatten_5, Data4=flatten_8)
panel_13 = Panel(merge_2)
integer_gate = IntegerGate(Int=merge_2)
rec_3 = DataRecorder(DataLimit=-10, RecordData=True)
rec_4 = DataRecorder(integer_gate, DataLimit=-10, RecordData=True)
panel_14 = Panel(rec_3)
panel_15 = Panel(rec_4)
panel_16 = Panel("""1
2
3
4""")
panel_17 = Panel("""1.020005
2.4
3.14159
4.312312""")
panel_18 = Panel("""1
2
3
4""")
panel_19 = Panel("""1
2
3
4""")
flatten_9 = FlattenTree(Tree=panel_16, Path="{3}")
flatten_10 = FlattenTree(Tree=panel_18, Path="{2;1}")
flatten_11 = FlattenTree(Tree=panel_17, Path="{0}")
flatten_12 = FlattenTree(Tree=panel_19, Path="{0;45}")
merge_3 = Merge(Data1=flatten_11, Data2=flatten_10, Data3=flatten_9, Data4=flatten_12)
panel_20 = Panel(merge_3)
number_gate = NumberGate(Num=Slider(6.646, range=0..10), Epsilon=Slider(0, range=0..0.001))
number_gate_2 = NumberGate(Num=merge_3, Epsilon="0.00000001")
rec_5 = DataRecorder(number_gate, DataLimit=-10, RecordData=True)
panel_21 = Panel(number_gate_2)
rec_6 = DataRecorder(number_gate_2, DataLimit=-10, RecordData=True)
panel_22 = Panel(rec_5)
panel_23 = Panel(rec_6)
panel_24 = Panel("""{0,0,1.061}
{1,2.1,3}""")
flatten_13 = FlattenTree(Tree="{2,3,4}", Path="{2;1}")
flatten_14 = FlattenTree(Tree=panel_24, Path="{0}")
merge_4 = Merge(Data1=flatten_14, Data2=flatten_13)
panel_25 = Panel(merge_4)
point_gate = PointGate(Pt=merge_4, Epsilon="0.0001")
rec_7 = DataRecorder(point_gate, DataLimit=-10, RecordData=True)
panel_26 = Panel(rec_7)
